# Grasshopper definition CityScope_RH_GH_Template.gh (Grasshopper 0.9.76)
# plug-ins: Python Interpreter, Firefly.X, HDTReference

# ---- group: table rotation in world
number_slider = Slider(0, range=-180..180)

# ---- group: cell size (meter)
number_slider_2 = Slider(62.5, range=0..1000)

# ---- group: Int Grid X Extent
# Parameters: Table Defination
number_slider_3 = Slider(16, range=1..20)

# ---- group: Int Grid Y Extent
number_slider_4 = Slider(16, range=1..20)

# ----
_4_commed = Slider(20, range=1..25)
_1_resmed = Slider(5, range=1..25)
_3_comhq = Slider(15, range=1..25)
# Parameters: Building Heights
_0_reslux = Slider(1, range=1..25)
_2_resmu = Slider(10, range=1..25)
# Defining the floor number for each
# building type.
_5_rescw = Slider(25, range=1..25)

# ----
# You need to adjust the file path to:
# "[your github folder]\CS_Rhino_Grasshopper_Template\maps\CityMatrix_ML_Cam.PNG"
# Input Option 3 - Camera Steam
path = FilePath("C:\Users\RYAN\Documents\GitHub\CS_Rhino_Grasshopper_Template\maps\CityMatrix_ML_Cam.PNG")
# Input Option 2 - Camera Snapshot Bitmap
load_bitmap = LoadBitmap(FilePathToImageLocation=path)

# ---- group: Select Input Option Here
# Input Option Selection
# Important: Select input option:
# Option 1 - Text
# Option 2 - WebCam SnapShot
# Opiton 3 - WebCam Stream
list = ValueList({"Input Option 1 - Text": 0, "Input Option 2 - WebCam SnapShot": 1, "Input Option 3 - WebCam Stream": 2}, selected="Input Option 1 - Text")

# ----
# Input Option 1 - Text
panel = Panel("""5,6,2,2,2,2,6,1,1,1,1,6,1,1,1,1
6,6,6,6,6,6,6,6,6,6,6,6,6,6,6,6
2,6,5,5,5,5,6,4,4,4,4,6,1,1,1,1
2,6,5,-1,-1,5,6,4,-1,-1,4,6,1,-1,-1,1
2,6,5,-1,-1,5,6,4,-1,-1,4,6,1,-1,-1,1
2,6,5,5,5,5,6,4,4,4,4,6,1,1,1,1
6,6,6,6,6,6,6,6,6,6,6,6,6,6,6,6
2,6,2,2,2,2,6,3,3,3,3,6,3,3,3,3
2,6,2,-1,-1,2,6,3,-1,-1,3,6,3,-1,-1,3
2,6,2,-1,-1,2,6,3,-1,-1,3,6,3,-1,-1,3
2,6,2,2,2,2,6,3,3,3,3,6,3,3,3,3
6,6,6,6,6,6,6,6,6,6,6,6,6,6,6,6
0,6,0,0,0,0,6,0,0,0,0,6,0,0,0,0
0,6,0,-1,-1,0,6,0,-1,-1,0,6,0,-1,-1,0
0,6,0,-1,-1,0,6,0,-1,-1,0,6,0,-1,-1,0
0,6,0,0,0,0,6,0,0,0,0,6,0,0,0,3""")

# ---- group: all color code quarts (no rotation)
panel_2 = Panel("2,0,0,0\t2,1,0,0\t2,0,1,0\t2,0,0,1\t2,1,1,0\t2,1,0,1\t2,0,1,1\t2,1,1,1\t3,0,0,0\t3,1,0,0\t3,0,1,0\t3,0,0,1\t3,1,1,0\t3,1,0,1\t3,0,1,1\t3,1,1,1\t4,0,0,0\t4,1,0,0\t4,0,1,0\t4,0,0,1\t4,1,1,0\t4,1,0,1\t4,0,1,1\t4,1,1,1\t5,0,0,0\t5,1,0,0\t5,0,1,0\t5,0,0,1\t5,1,1,0\t5,1,0,1\t5,0,1,1\t5,1,1,1")

# ---- group: Sample White
# Reference Color
pt = Point(<point referenced from the Rhino model>)

# ---- group: Sample Black
pt_2 = Point(<point referenced from the Rhino model>)

# ---- group: Sample Red
# Grid Sampling
pt_3 = Point(<point referenced from the Rhino model>)

# ---- group: module meshes lego ref: -1
# Building Type Mesh (Reference in Rhino File)
mesh = Mesh(<mesh referenced from the Rhino model>)

# ---- group: module meshes lego ref: 0 to 5
# Reference in the Building or Road
# geometry from Rhino. They will be
# instantiated/copied to the cell position
# where it has the same Type ID.
# 
# To simplify the data tree. The reference
# geometry should be single Mesh. You
# can paint different mesh with the set-up
# on the right, and join them together.
mesh_2 = Mesh([<mesh referenced from the Rhino model> x6])

# ---- group: all color code quarts (with rotation)
# Decode Piece ID
panel_3 = Panel("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")

# ----
# To use input Option 3
# - Camera stream, you need to:
# 1) enable this component;
# 2) right click and select
# slow (1 second);
# 3) right click and select
# highest resolution.
video_stream = WebCamVideoStream()  # disabled

# ---- group: Pts Sample Grid Corner
pt_4 = Point([<point referenced from the Rhino model> x4])

# ----
pline = PolyLine(Vertices=pt_4, Closed=False)

# ---- group: x_ext
int = Integer(number_slider_3)

# ---- group: gridExtent_x
int_2 = Integer(int)

# ---- group: y_ext
int_3 = Integer(number_slider_4)

# ---- group: gridExtent_y
int_4 = Integer(int_3)

# ---- group: latitude
num = Number("42.360357")

# ---- group: tableRotation
num_2 = Number(number_slider)

# ---- group: longitude
num_3 = Number("-71.087264")

# ---- group: cellSize
num_4 = Number(number_slider_2)

# ----
preview = CustomPreview(Geometry=pline, Shader=ColourSwatch(SwatchColor=RGB(255, 0, 230)))
int_5 = Integer(_5_rescw)
int_6 = Integer(_4_commed)
int_7 = Integer(_3_comhq)
crv = Curve(<curve referenced from the Rhino model>)
int_8 = Integer(_2_resmu)
crv_2 = Curve(<curve referenced from the Rhino model>)
crv_3 = Curve(<curve referenced from the Rhino model>)
int_9 = Integer(_1_resmed)
int_10 = Integer(_0_reslux)
boundary = BoundarySurfaces(Edges=crv)
boundary_2 = BoundarySurfaces(Edges=crv_3)
boundary_3 = BoundarySurfaces(Edges=crv_2)
multiplication = Multiplication(A=int_4, B=2)
merge = Merge(Data1=int_10, Data2=int_9, Data3=int_8, Data4=int_7, Data5=int_6, Data6=int_5)
multiplication_2 = Multiplication(A=int_2, B=2)

# ---- group: mesh coloring in rhino
mesh_3 = Mesh(<mesh referenced from the Rhino model>)
res_color = ColourSwatch(SwatchColor=RGB(251, 255, 122))
sidewalk = ColourSwatch(SwatchColor=RGB(107, 107, 107))
res_gray = ColourSwatch(SwatchColor=RGB(227, 227, 227))
bikelane = ColourSwatch(SwatchColor=RGB(86, 135, 87))
off_gray = ColourSwatch(SwatchColor=RGB(171, 171, 171))
offcolor = ColourSwatch(SwatchColor=RGB(255, 122, 122))
parking = ColourSwatch(SwatchColor=RGB(196, 156, 100))
blank = ColourSwatch(SwatchColor=RGB(110, 110, 110))
road = ColourSwatch(SwatchColor=RGB(64, 64, 64))
park = ColourSwatch(SwatchColor=RGB(165, 201, 44))
text = ColourSwatch(SwatchColor=RGB(0, 0, 0))
res_warm = ColourSwatch(SwatchColor=RGB(255, 251, 230))
text_new = ColourSwatch(SwatchColor=RGB(64, 64, 64))
off_cold = ColourSwatch(SwatchColor=RGB(230, 242, 255))
mcol = MeshColours(Mesh=mesh_3, Colours=off_cold)
mesh_4 = Mesh(mcol)

# ---- group: tab
panel_4 = Panel("\t")

# ----
split = TextSplit(Text=panel_3, Separators=panel_4)
mesh_5 = MeshBrep(
    Brep=boundary,
    Settings={GridMaxCount=0, GridMinCount=16, JaggedSeams=False, MaxEdgeLength=0, MinEdgeLength=0.0001, MinTolerance=0, Refine=True, RefineAngle=0, RelativeTolerance=0.65, SimplePlanes=True, Tolerance=0})
mesh_6 = MeshBrep(
    Brep=boundary_2,
    Settings={GridMaxCount=0, GridMinCount=16, JaggedSeams=False, MaxEdgeLength=0, MinEdgeLength=0.0001, MinTolerance=0, Refine=True, RefineAngle=0, RelativeTolerance=0.65, SimplePlanes=True, Tolerance=0})
mesh_7 = MeshBrep(
    Brep=boundary_3,
    Settings={GridMaxCount=0, GridMinCount=16, JaggedSeams=False, MaxEdgeLength=0, MinEdgeLength=0.0001, MinTolerance=0, Refine=True, RefineAngle=0, RelativeTolerance=0.65, SimplePlanes=True, Tolerance=0})
perspective = Perspective(pt=pt_4, int_2=multiplication_2, int=multiplication)

# ---- group: floor height
panel_5 = Panel("3.5")

# ---- group: floor num for each type
int_11 = Integer(merge)

# ---- group: input option selection
int_12 = Integer(list)

# ---- group: all color quarts data
txt = Text(split)

# ----
lng = ListLength(List=txt)
# For Text Data, simple edit the text panel on
# the left (arrow 1), by change the ID in each
# slot, you change what building module to
# copy to the stage. Currently, ID -1 is blank,
# ID 0 to 5 are 6 different building type.
textformating = TextFormating(txt=panel)
multiplication_3 = Multiplication(A=int_11, B=panel_5)
division = Division(A=lng, B="4")

# ---- group: x
series = Series(Start=0, Step=1, Count=int_2)

# ---- group: y
series_2 = Series(Start=0, Step=1, Count=int_4)

# ---- group: webcam snapshot
data = Data(load_bitmap)

# ---- group: webcam stream
# Everthing below this line is only for
# CityScope scanning. You need a
# physical CityScope table. Or at least
# a screenshot of the camera reading
# of the CityScope table.
data_2 = Data(video_stream)

# ----
panel_6 = Panel(txt)
series_3 = Series(Start=0, Step=1, Count=division)

# ---- group: building height for each type
num_5 = Number(multiplication_3)

# ----
multiplication_4 = Multiplication(A=series_2, B=4)
multiplication_5 = Multiplication(A=series, B=2)
pshift = ShiftPaths(Data=series_3, Offset=-1)
multiplication_6 = Multiplication(A=division, B="4")

# ---- group: keystoned grid pts
pt_5 = Point(perspective)

# ---- group: all module piece ids - from Text Data
int_13 = Integer(textformating)

# ----
multiplication_7 = Multiplication(A=multiplication_4, B=int_2)
pshift_2 = ShiftPaths(Data=pt_5, Offset=-1)

# ---- group: all sample pts
pt_6 = Point(pshift_2)

# ----
repeat = RepeatData(Data=pshift, Length=multiplication_6)
box = CenterBox(Base=pt_6, X=0.003, Y=0.003, Z=0.003)
addition = Addition(A=multiplication_5, B=graft(multiplication_7))
pshift_3 = ShiftPaths(Data=repeat, Offset=-1)

# ---- group: all color quart ids
int_14 = Integer(pshift_3)

# ---- group: all sample boxes
box_2 = Box(box)

# ---- group: all ref colors
col = Colour([RGB(198, 184, 140), RGB(96, 87, 65), RGB(153, 81, 42)])

# ----
pshift_4 = ShiftPaths(Data=addition, Offset=-1)
panel_7 = Panel(int_14)
multiplication_8 = Multiplication(A=int_2, B=2)
addition_2 = Addition(A=pshift_4, B=multiplication_8)
addition_3 = Addition(A=pshift_4, B=1)
addition_4 = Addition(A=addition_2, B=1)

# ---- group: sample pts
item = ListItem(List=pt_6, Index=addition_2, Wrap=False)
item_2 = ListItem(List=pt_6, Index=pshift_4, Wrap=False)
item_3 = ListItem(List=pt_6, Index=addition_4, Wrap=False)
item_4 = ListItem(List=pt_6, Index=addition_3, Wrap=False)

# ----
addition_5 = Addition(A=item_2, B=item_3)
filter = StreamFilter(Gate=int_12, Stream1=data, Stream2=data_2)
division_2 = Division(A=addition_5, B=2)

# ---- group: quart mid pts
pt_7 = Point(division_2)

# ---- group: webcam feed (stream or snapshot)
data_3 = Data(filter)

# CityScope Scanning GH
# Shared Components for Input Option 2 and 3
data_4 = Data(data_3)

# ---- group: CityMatrix CV Calibration
mesh_8 = MeshFromImage(Bmp=data_4, Sx=Domain(0, 1), Sy=Domain(0, 1), Z=0, C=True)

# ---- group: webcam stream
bmp = BitmapToModify(data_4)

# ----
sample = BitmapSampler(BitmapToModify=bmp, PointToSample=pt_2, BitmapToModify_2=bmp, PointToSample_2=pt_2, bitmap_filter=0)  # -> SampledImageData, SampledImageData_2
sample_2 = BitmapSampler(BitmapToModify=bmp, PointToSample=pt_3, BitmapToModify_2=bmp, PointToSample_2=pt_3, bitmap_filter=0)  # -> SampledImageData, SampledImageData_2
sample_3 = BitmapSampler(BitmapToModify=bmp, PointToSample=pt, BitmapToModify_2=bmp, PointToSample_2=pt, bitmap_filter=0)  # -> SampledImageData, SampledImageData_2
col_2 = Colour(sample.SampledImageData_2)
col_3 = Colour(sample_3.SampledImageData_2)
col_4 = Colour(sample_2.SampledImageData_2)

# ---- group: webcam stream
bmp_2 = BitmapToModify(data_4)

# ----
mcol_2 = MeshColours(Mesh=mesh_5, Colours=col_2)
mcol_3 = MeshColours(Mesh=mesh_6, Colours=col_4)
mcol_4 = MeshColours(Mesh=mesh_7, Colours=col_3)
preview_2 = CustomPreview(
    Geometry=mcol_2,
    Shader={ambient=RGB(0, 0, 0), diffuse=RGB(255, 105, 180), emission=RGB(76, 32, 54), shine=0.5, specular=RGB(255, 255, 255), transparency=0})
preview_3 = CustomPreview(
    Geometry=mcol_3,
    Shader={ambient=RGB(0, 0, 0), diffuse=RGB(255, 105, 180), emission=RGB(76, 32, 54), shine=0.5, specular=RGB(255, 255, 255), transparency=0})
preview_4 = CustomPreview(
    Geometry=mcol_4,
    Shader={ambient=RGB(0, 0, 0), diffuse=RGB(255, 105, 180), emission=RGB(76, 32, 54), shine=0.5, specular=RGB(255, 255, 255), transparency=0})
sample_4 = BitmapSampler(BitmapToModify=bmp_2, PointToSample=pt_6, BitmapToModify_2=bmp_2, PointToSample_2=pt_6, bitmap_filter=0)  # -> SampledImageData, SampledImageData_2
merge_2 = Merge(Data1=col_3, Data2=col_2, Data3=col_4)

# ---- group: all sample color
col_5 = Colour(sample_4.SampledImageData_2)

# ----
# Closest Color Code
dist = Distance(PointA=graft(col_5), PointB=col)
lng_2 = ListLength(List=dist)
series_4 = Series(Start=0, Step=1, Count=lng_2)
int_15 = Integer(series_4)
sort = SortList(Keys=dist, ValuesA=int_15)  # -> Keys, ValuesA
item_5 = ListItem(List=sort.ValuesA, Index=0, Wrap=False)
pshift_5 = ShiftPaths(Data=item_5, Offset=-1)
pshift_6 = ShiftPaths(Data=pshift_5, Offset=-1)

# ---- group: color code of each smaple pt
int_16 = Integer(pshift_6)

# ----
item_6 = ListItem(List=col, Index=int_16, Wrap=False)
preview_5 = CustomPreview(Geometry=box_2, Shader=item_6)

# ---- group: color codes
item_7 = ListItem(List=int_16, Index=pshift_4, Wrap=False)
item_8 = ListItem(List=int_16, Index=addition_2, Wrap=False)
item_9 = ListItem(List=int_16, Index=addition_4, Wrap=False)
item_10 = ListItem(List=int_16, Index=addition_3, Wrap=False)

# ----
merge_3 = Merge(Data1=graft(item_7), Data2=graft(item_8), Data3=graft(item_9), Data4=graft(item_10))

# ---- group: color code quarts
int_17 = Integer(merge_3)

# ----
rev = ReverseList(List=int_17)
txt_2 = Text(rev)
join = TextJoin(Text=txt_2, Join=",")
pshift_7 = ShiftPaths(Data=join, Offset=-1)

# ---- group: color code quart texts
txt_3 = Text(pshift_7)

# ----
keysearch = KeyValueSearch(Keys=txt, Values=int_14, Search=graft(txt_3))
nullrep = ReplaceNulls(Items=keysearch, Replacements="-1")  # -> Items, Count
pshift_8 = ShiftPaths(Data=nullrep.Items, Offset=-1)

# ---- group: all module piece ids
int_18 = Integer(pshift_8)

# ----
tag = TextTag3D(Location=pt_7, Text=int_18, Size=0.01, Justification=5)
panel_8 = Panel(int_18)

# ---- group: all module piece ids - from CityScope Scanning GH
int_19 = Integer(int_18)

# ---- group: Module ID from selected input option
filter_2 = StreamFilter(Gate=int_12, Stream0=int_13, Stream1=int_19, Stream2=int_19)

# ---- group: module id from selected input option
int_20 = Integer(filter_2)

# ---- group: height for each cell
item_11 = ListItem(List=num_5, Index=int_20, Wrap=False)
nullrep_2 = ReplaceNulls(Items=item_11, Replacements="0.0")  # -> Items, Count

# ---- group: height (meter)
num_6 = Number(nullrep_2.Items)

# ---- group: module type id
int_21 = Integer(int_20)

# ---- group: x
int_22 = Integer([0, 1, 2, 3, 4, 5, 6, 7, 8, 9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])

# ---- group: height (meter)
num_7 = Number(num_6)

# ---- group: y
int_23 = Integer([0, 0, 0, 0, 0, 0, 0, 0, 0, 0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])

# ---- group: rotation
int_24 = Integer([0, 0, 0, 0, 0, 0, 0, 0, 0, 0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])

# ----
panel_9 = Panel(num_7)
# CityMatrix
# 
# "Ryan" Yan Zhang <ryanz@mit.edu>
# MIT Media Lab, Changing Place Group
# September. 2016
# Dynamic
# Input
# Data
panel_10 = Panel(int_21)
panel_11 = Panel(int_24)
panel_12 = Panel(int_22)
panel_13 = Panel(int_23)

# ---- group: intervention
panel_14 = Panel("0.00001")
panel_15 = Panel("0")

# ---- group: x
int_25 = Integer(int_22)

# ---- group: y
int_26 = Integer(int_23)

# ----
pt_8 = ConstructPoint(XCoordinate=int_25, YCoordinate=int_26, ZCoordinate=0)
pt_9 = ConstructPoint(XCoordinate=panel_14, YCoordinate=panel_15, ZCoordinate=0)

# ----
# Heatmap Example
# Here's the code for the abstract point
# color example I shown in the class.
# It's a very good starting point to build
# your own logic without worring about
# the output part too much.
# 
# Currently, move arround the 2 reference
# points will change the heatmap.
# 
# Mind that the x,y coordinate is from
# 0 to 15, so it is pretty small. Zoom in to
# see the points, or you can use Camera
# "HeatMapPts" saved for you.
pt_10 = Point(<point referenced from the Rhino model>)
pt_11 = Point(<point referenced from the Rhino model>)

dist_2 = Distance(PointA=pt_11, PointB=pt_8)
dist_3 = Distance(PointA=pt_10, PointB=pt_8)
min = Minimum(A=dist_3, B=dist_2)
panel_16 = Panel(min)

# ---- group: safety score
division_3 = Division(A="1", B=panel_16)

# ----
panel_17 = Panel(division_3)
gradient = Gradient(LowerLimit=0, UpperLimit=1, Parameter=division_3, stops=[0: RGB(255, 0, 0), 0.5: RGB(255, 255, 0), 1: RGB(0, 128, 0)])
preview_6 = CustomPreview(Geometry=pt_8, Shader=gradient)
# objects
panel_18 = Panel("0.0")

# ---- group: Barcelona
num_8 = Number([0.864575, 0.6386, 0.861025, 0.798575, 0.8455, 0.653475, 0.775425, 0.788425, 0.6805, 0.85095, 0.575675, 0.473775, 0.879825, 0.865175, 0.66325, 0.759725, 0.717475, 0.8056, 0.861, 0.730125, 0.849825, 0.83865, 0.860875, 0.742875])

# ---- group: all radar chart titles
txt_4 = Text(["Residential", "Employment", """3rd
Places
(Day)""", """3rd
Places
(Night)""", "Cultural", "Co-working", "Educational", "Parks", """Public
Transportation""", """Intersection
Density""", "Security", """Healthy
Food""", """Physical
Activity""", "Healthcare", "Residential", "Employment", """Residential
Employment
Ratio""", """3rd
Places""", "Cultural", "Educational"])

# ---- group: title group numbers
int_27 = Integer([7, 7, 6])

# ---- group: radar chart parameters
x_coordinate_of_graph = Slider(2200, range=0..3000)
window_height = Slider(1200, range=0..3000)
number_slider_5 = Slider(300, range=0..1000)
window_width = Slider(2200, range=0..3000)
number_slider_6 = Slider(-200, range=-1000..2000)
number_slider_7 = Slider(0, range=-1000..2000)
swatch = ColourSwatch(SwatchColor=RGBA(0, 0, 0, 0))
multiplication_9 = Multiplication(A=window_height, B=Slider(0.25, range=0..1))
y_coordinate_of_graph_w_i_screen = Number(multiplication_9)
pt_12 = ConstructPoint(XCoordinate=x_coordinate_of_graph, YCoordinate=expr("x*(-1)", y_coordinate_of_graph_w_i_screen), ZCoordinate=0)

# ---- group: all radar chart values - normalized
# Radar Chart
# (by Carson, Dalma, Ryan)
num_9 = Number(Tree({0;0}: [0.454765, 0.3861125, 0.53661425, 0.41454225, 0.51671925, 0.2895, 0.42567825, 0.24637675, 0.52770825, 0.53577675, 0.470658, 0.46976125, 0.50661225, 0.4908575, 0.439484, 0.34200825, 0.381088, 0.35462625, 0.5068225, 0.53578475], {1;0}: [0.45467, 0.3861125, 0.53653925, 0.41451725, 0.51669425, 0.2895, 0.42562725, 0.24627675, 0.52764325, 0.53571575, 0.470558, 0.46966125, 0.50656125, 0.4907575, 0.439429, 0.34200825, 0.3810375, 0.35455125, 0.506772, 0.53568475]))

# ---- group: x_ext
int_28 = Integer(int)

# ---- group: shrink
cell_shrink = Slider(0.98, range=0.75..1)

# ---- group: toggle1
bool = Boolean(False)

# ---- group: module meshes lego ref: -1
mesh_9 = Mesh(mesh)

# ---- group: y_ext
int_29 = Integer(int_3)

# ---- group: rotation
int_30 = Integer(int_24)

# ---- group: module id
int_31 = Integer(int_21)

# ---- group: y
int_32 = Integer(int_23)

# ---- group: module meshes lego ref: 0 to 5
mesh_10 = Mesh(mesh_2)

# ---- group: x
int_33 = Integer(int_22)

# ---- group: colortizer orgin
# LEGO Grid System Visualization
pt_13 = Point(<point referenced from the Rhino model>)

# ---- group: table size ref pt
pt_14 = Point(<point referenced from the Rhino model>)

# ----
Z = UnitZ(Factor=20)
panel_19 = Panel("C:\Users\RYAN\Dropbox (MIT)\01_Work\MAS\06_Fall 2016\CityMatrix\01_Software\RH_GH\Map\HAMBURG RS 1600pxl.jpg")

# ----
# Google Map @ Lego
show_google_map = BooleanToggle(False)

# ---- group: x
# grid
int_34 = Integer(flatten(int_22))

# ---- group: y
int_35 = Integer(flatten(int_23))

# ---- group: rotation
int_36 = Integer(flatten(int_24))

# ---- group: slider1
num_10 = Number(flatten(panel_18))

# ---- group: toggle1
bool_2 = Boolean(flatten("false"))

# ---- group: dockID
int_37 = Integer(flatten("-1"))

# ---- group: x_ext
# JSON Text Composer
# header
#  > spatial
int_38 = Integer(flatten(int))

# ---- group: dockRotation
int_39 = Integer(flatten("0"))

# ---- group: type id
int_40 = Integer(flatten(int_21))

# ---- group: height (meter)
num_11 = Number(flatten(num_7))

# ---- group: y_ext
int_41 = Integer(flatten(int_3))

# ---- group: latitude
num_12 = Number(flatten(num))

# ---- group: tableRotation
num_13 = Number(flatten(num_2))

# ---- group: cellSize (meter)
num_14 = Number(flatten(num_4))

# ---- group: longitude
num_15 = Number(flatten(num_3))

# ----
panel_20 = Panel(txt_4)
xy = XYPlane(Origin=pt_13)
dist_4 = Distance(PointA=pt_13, PointB=pt_14)
timer = Timer(TimerInterval=500, Target=division_4)  # disabled

# ---- group: toggle1 > integer
int_42 = Integer(bool_2)

# ----
division_4 = Division(A=dist_4, B=int_28)
movetoorgin = MoveToOrgin(G=mesh_9, num=cell_shrink)
movetoorgin_2 = MoveToOrgin(G=mesh_10, num=cell_shrink)

# ---- group: base cplane
pln = Plane(xy)

# ----
planesrf = PlaneSurface(Plane=pln, XSize=Domain(0, 1000), YSize=Domain(-1000, 0))
move = Move(Geometry=planesrf, Motion=Z)  # -> Geometry, Transform
filter_3 = StreamFilter(Gate=show_google_map, Stream1=move.Geometry)
lng_3 = ListLength(List=txt_4)

# ---- group: cell size
num_16 = Number(division_4)

# ----
modulecenter = ModuleCenter(pt=pt_13, num=num_16, int_2=int_33, int=int_32)  # -> pt_5, transform_2
previewmat = CustomPreviewMaterials(Geometry=filter_3, DiffuseColor=ColourSwatch(SwatchColor=RGB(255, 255, 255)), Transparency="0.0", DiffuseBitmap=panel_19)

# ---- group: module center
pt_15 = Point(modulecenter.pt_5)

# ---- group: module meshes lego at orgin
mesh_11 = Mesh(movetoorgin_2)

mesh_12 = Mesh(movetoorgin)

# ----
larger = LargerThan(FirstNumber=int_31, SecondNumber="0")  # -> LargerThan, OrEqualTo
smaller = SmallerThan(FirstNumber=int_31, SecondNumber="5")  # -> SmallerThan, OrEqualTo
and = GateAnd(A=larger.OrEqualTo, B=smaller.OrEqualTo)
json_composer_py = PythonScript(
    x_ext=int_38,
    y_ext=int_41,
    latitude=num_12,
    longitude=num_15,
    tableRotation=num_13,
    cellSize=num_14,
    x=int_34,
    y=int_35,
    rotation=int_36,
    typeID=int_40,
    height=num_11,
    slider1=num_10,
    toggle1=int_42,
    dockID=int_37,
    dockRotation=int_39)  # -> out, jsonData; inputs x: list, y: list, rotation: list, typeID: list, height: list
# ---------- json_composer_py: Python ----------
import json

# header
spatial = {}
spatial['x_ext'] = x_ext
spatial['y_ext'] = y_ext
spatial['latitude'] = latitude
spatial['longitude'] = longitude
spatial['rotation'] = tableRotation
spatial['cellSize'] = cellSize
block = ['type', 'height', 'rotation']
type = {}
type['-1'] = 'BLANK'
type['0'] = 'RL'
type['1'] = 'RM'
type['2'] = 'RS'
type['3'] = 'OL'
type['4'] = 'OM'
type['5'] = 'OS'
type['6'] = 'ROAD'
mapping = {}
mapping['type'] = type
header = {}
header['spatial'] = spatial
header['block'] = block
header['mapping'] = mapping

# grid
grid = []
cellNum = x_ext * y_ext
for i in range(cellNum):
    grid.append([typeID[i], height[i], rotation[i]])

# objects
objects = {}
objects['slider1'] = slider1
objects['toggle1'] = toggle1
objects['dockID'] = dockID
objects['dockRotation'] = dockRotation

# dump json data
data = {}
data['header'] = header
data['grid'] = grid
data['objects'] = objects
jsonData = json.dumps(data)


"""
predict = jsonData['predict']

grid = predict['grid']
#print str(grid)
rots = []
types = []
xs = []
ys = []
traffics = []
waits = []
solars = []
for cell in grid:
    #print cell
    rot = cell['rot']
    type = cell['type']
    x = cell['x']
    y = cell['y']
    
    # Traffic
    if type == 6: 
        #print "is road!"
        dataResult = cell['data']
        #print dataResult
        traffic = float(dataResult['traffic'])
        #print traffic
        wait = float(dataResult['wait'])
        #print wait
    else:
        #print "is NOT road!"
        traffic = -1.0
        wait = -1.0
    #print traffic
    #print wait
    rots.append(rot)
    types.append(type)
    xs.append(x)
    ys.append(y)
    traffics.append(traffic)
    waits.append(wait)
    
    # Solar
    dataResult = cell['data']
    solar = float(dataResult['solar'])
    solars.append(solar)
    
#print rots
#print types
#print xs
#print ys
#print traffics
#print waits

objects = predict['objects']
densities = objects['densities']

m = objects['metrics']
metrics = []
metrics.append(m['Density']['metric'])
metrics.append(m['Diversity']['metric'])
metrics.append(m['Energy']['metric'])
metrics.append(m['Traffic']['metric'])
metrics.append(m['Solar']['metric'])


AIStep = objects['AIStep']
#print 'AIStep: ' + str(AIStep)
toggle1 = objects['toggle1']
#print 'toggle1: ' + str(toggle1)
slider1 = objects['slider1']
#print 'slider1: ' + str(slider1)
slider2 = objects['slider2']
#print 'slider2: ' + str(slider2)
dockID = objects['dockID']
#print 'dockID: ' + str(dockID)
dockRotation = objects['dockRotation']
#print 'dockRotation: ' + str(dockRotation)
animBlink = objects['animBlink']
#print 'animBlink: ' + str(animBlink)


animActivation = True
"""
# ---------- end json_composer_py ----------

# ---- group: Background grid
number_slider_8 = Slider(6, range=0..100)
division_5 = Division(A=number_slider_5, B=number_slider_8)
series_5 = Series(Start=0, Step=division_5, Count=number_slider_8)
polygon = Polygon(Plane=pt_12, Radius=number_slider_5, Segments=Slider(63, range=0..100), FilletRadius=Slider(4, range=0..10))  # -> Polygon, Length
cull_i = CullIndex(List=series_5, Indices=Slider(0, range=0..100), Wrap=True)
number_slider_9 = Slider(223, range=0..1000)
swatch_2 = ColourSwatch(SwatchColor=RGB(87, 87, 87))
polygon_2 = Polygon(Plane=pt_12, Radius=cull_i, Segments=Slider(63, range=0..100), FilletRadius=Slider(4, range=0..10))  # -> Polygon, Length

# ---- group: Chart curves
panel_21 = Panel(num_9)
polygon_3 = Polygon(Plane=pt_12, Radius=number_slider_5, Segments=lng_3, FilletRadius=0)  # -> Polygon, Length
cp = ControlPoints(Curve=polygon_3.Polygon)  # -> Points, Weights, Knots
partition = PartitionList(List=panel_21, Size=graft(lng_3))
cull_i_2 = CullIndex(List=cp.Points, Indices=lng_3, Wrap=True)
panel_22 = Panel(partition)
ln = Line(StartPoint=pt_12, EndPoint=graft(cull_i_2))
dom = ConstructDomain(DomainStart=Slider(0, range=0..100), DomainEnd=Slider(1, range=0..100))
remap = RemapNumbers(Value=[panel_22, num_8], Source=dom, Target=Domain(0, 1))  # -> Mapped, Clipped
eval = EvaluateCurve(Curve=flatten(ln), Parameter=remap.Mapped)  # -> Point, Tangent, Angle
pline_2 = PolyLine(Vertices=eval.Point, Closed=True)
fillet = Fillet(Curve=pline_2, Radius=0)  # disabled
branch = TreeBranch(Tree=pline_2, Path="{0;0;1;0}", MaintainPaths=True)
branch_2 = TreeBranch(Tree=pline_2, Path="{0;0;0;0}", MaintainPaths=True)
col_6 = Colour(graft([ColourSwatch(SwatchColor=RGBA(58, 255, 91, 136)), ColourSwatch(SwatchColor=RGBA(16, 76, 135, 159)), ColourSwatch(SwatchColor=RGBA(140, 191, 230, 175))]))
loft = Loft(
    Curves=flatten([branch_2, branch]),
    Options={Adjust=False, Closed=False, LoftEnds=0, LoftSimp=0, LoftType=3, Rebuild=10, Refit=0.01})
swatch_3 = ColourSwatch(SwatchColor=RGB(97, 97, 97))
preview_7 = CustomPreview(Geometry=loft, Shader=ColourSwatch(SwatchColor=RGBA(126, 169, 230, 238)))

# ----
dispatch = Dispatch(List=int_31, DispatchPattern=and)  # -> ListA, ListB
smaller_2 = SmallerThan(FirstNumber=int_31, SecondNumber="0")  # -> SmallerThan, OrEqualTo
item_12 = ListItem(List=mesh_11, Index=graft(dispatch.ListA), Wrap=False)
dispatch_2 = Dispatch(List=pt_15, DispatchPattern=smaller_2.SmallerThan)  # -> ListA, ListB
pshift_9 = ShiftPaths(Data=item_12, Offset=-1)
dispatch_3 = Dispatch(List=int_30, DispatchPattern=and)  # -> ListA, ListB
vec2pt = Vector2Pt(PointA=Point(0, 0, 0), PointB=dispatch_2.ListA, Unitize=False)  # -> Vector, Length

# ---- group: example data format
panel_23 = Panel("""{
  "header" : {
    "spatial": { 
      "x_ext" : 1,
      "y_ext": 1, 
      "latitude":42.360357,
      "longitude": -71.087264,
      "rotation": 0.1,
      "cellSize": 10
    },
    "block": ["x", "y", "rotation", "type", "height"],
    "mapping": {
      "type":{"0":"RL", "1":"RM", "2":"RS", "3":"OL", "4":"OM", "5":"OS", "6":"ROAD"}
    }
  },
  "meta" : {
    "apiv": "v2.0",
    "timestamp": 1517076690,
    "id": "eWRhpRV"
  },
  "grid" : [
    [0, 0, 90, 0, 30.0]
  ],
  "objects" : {
  }
}""")

# ----
rotate = Rotate(Geometry=pshift_9, Angle=degrees(dispatch_3.ListA), Plane=PlaneXY(0, 0, 0))  # -> Geometry, Transform
dispatch_4 = Dispatch(List=pt_15, DispatchPattern=and)  # -> ListA, ListB
move_2 = Move(Geometry=mesh_12, Motion=vec2pt.Vector)  # -> Geometry, Transform
vec2pt_2 = Vector2Pt(PointA=Point(0, 0, 0), PointB=dispatch_4.ListA, Unitize=False)  # -> Vector, Length
move_3 = Move(Geometry=rotate.Geometry, Motion=vec2pt_2.Vector)  # -> Geometry, Transform

# ---- group: JSON Text
txt_5 = Text(json_composer_py.jsonData)

# ----
panel_24 = Panel(txt_5)
panel_25 = Panel(int_27)

# ---- group: Chart labels
multiplication_10 = Multiplication(A=number_slider_5, B=Slider(1.3, range=0..3))
multiplication_11 = Multiplication(A=number_slider_5, B=Slider(1.8, range=0..3))
polygon_4 = Polygon(Plane=pt_12, Radius=multiplication_10, Segments=lng_3, FilletRadius=Slider(0, range=0..10))  # -> Polygon, Length
cp_2 = ControlPoints(Curve=polygon_4.Polygon)  # -> Points, Weights, Knots
swatch_4 = ColourSwatch(SwatchColor=RGB(128, 128, 128))
number_slider_10 = Slider(11, range=0..100)
cull_i_3 = CullIndex(List=cp_2.Points, Indices=lng_3, Wrap=True)
col_7 = Colour([ColourSwatch(SwatchColor=RGB(224, 224, 224)), ColourSwatch(SwatchColor=RGB(79, 79, 79)), ColourSwatch(SwatchColor=RGB(153, 153, 153))])
repeat_2 = RepeatData(Data=graft(col_7), Length=graft(panel_25))  # -> flatten(Data)

# ---- group: ledgend
number_slider_11 = Slider(60, range=0..200)
pdecon = Deconstruct(Point=pt_12)  # -> XComponent, YComponent, ZComponent
addition_6 = Addition(A=multiplication_11, B=pdecon.XComponent)
neg = Negative(Value=Slider(400, range=0..1000))
neg_2 = Negative(Value=number_slider_11)
addition_7 = Addition(A=pdecon.XComponent, B=neg)
X = UnitX(Factor=neg_2)
subtraction = Subtraction(A=number_slider_11, B=Slider(14, range=0..20))
pt_16 = ConstructPoint(XCoordinate=addition_7, YCoordinate=0, ZCoordinate=0)
Y = UnitY(Factor=Slider(800, range=0..1000))
neg_3 = Negative(Value=Y)
move_4 = Move(Geometry=pt_16, Motion=neg_3)  # -> Geometry, Transform
move_5 = Move(Geometry=move_4.Geometry, Motion=X)  # -> Geometry, Transform
rectangle = Rectangle(Plane=move_5.Geometry, XSize=subtraction, YSize=Slider(5, range=0..10), Radius=0)  # -> Rectangle, Length
mesh_13 = MeshBrep(
    Brep=rectangle.Rectangle,
    Settings={GridMaxCount=0, GridMinCount=16, JaggedSeams=False, MaxEdgeLength=0, MinEdgeLength=0.0001, MinTolerance=0, Refine=True, RefineAngle=0, RelativeTolerance=0.65, SimplePlanes=True, Tolerance=0})
series_6 = Series(Start=0, Step=Slider(24, range=15..30), Count=3)
panel_26 = Panel("""Barcelona
Site with Changes
Current Site""")
Y_2 = UnitY(Factor=series_6)
neg_4 = Negative(Value=Y_2)
move_6 = Move(Geometry=mesh_13, Motion=neg_4)  # -> Geometry, Transform
preview_8 = CustomPreview(Geometry=graft(move_6.Geometry), Shader=col_6)
tag_2 = TextTag3D(
    Location=move_4.Geometry,
    Text=panel_26,
    Size=Slider(14, range=0..100),
    Colour=ColourSwatch(SwatchColor=RGB(255, 255, 255)),
    Justification=4)

# ---- group: CityMatrix CV Calibration / building lego modules
mesh_14 = Mesh(move_3.Geometry)

# ---- group: CityMatrix CV Calibration / blank
mesh_15 = Mesh(move_2.Geometry)

# ---- group: Chart curves / radar back lines
preview_9 = CustomPreview(Geometry=ln, Shader=swatch_3)

# ---- group: Chart curves / plotes
preview_10 = CustomPreview(Geometry=pline_2, Shader=col_6)

# ---- group: Chart labels / titles
tag_3 = TextTag3D(Location=cull_i_3, Text=txt_4, Size=number_slider_10, Colour=repeat_2, Justification=5)

# ---- group: Background grid / plots
preview_11 = CustomPreview(Geometry=[polygon.Polygon, polygon_2.Polygon], Shader=swatch_2)

# ---- group: module center
pt_17 = Point(pt_15)

# ---- group: 3D building site move amount
# 3D City Grid System Visualization
panel_27 = Panel("10000")
X_2 = UnitX(Factor=panel_27)

# ---- group: module id
int_43 = Integer(int_21)

# ---- group: building height for each type
num_17 = Number(num_5)

# ----
# Send to CityI/O Server
panel_28 = Panel("https://cityio.media.mit.edu")

# ---- group: table name on server
panel_29 = Panel("citymatrix_template")

# ----
com = ColourSwatch(SwatchColor=RGB(158, 158, 158))
com_2 = ColourSwatch(SwatchColor=RGB(71, 71, 71))
res = ColourSwatch(SwatchColor=RGB(212, 212, 212))
res_2 = ColourSwatch(SwatchColor=RGB(76, 76, 76))

# ---- group: blank
mesh_16 = Mesh(mesh_15)

# ----
larger_2 = LargerThan(FirstNumber=int_43, SecondNumber="0")  # -> LargerThan, OrEqualTo
smaller_3 = SmallerThan(FirstNumber=int_43, SecondNumber="5")  # -> SmallerThan, OrEqualTo

# ---- group: road mesh final!
mesh_17 = Mesh()

# ---- group: sidewalk mesh final!
mesh_18 = Mesh()

# ----
vec = Vector(X_2)
merge_4 = Merge(Data1=res, Data2=res, Data3=res, Data4=com, Data5=com, Data6=com)
merge_5 = Merge(Data1=res_2, Data2=res_2, Data3=res_2, Data4=com_2, Data5=com_2, Data6=com_2)
and_2 = GateAnd(A=larger_2.OrEqualTo, B=smaller_3.OrEqualTo)
merge_6 = Merge(Data1=merge_4, Data2=merge_5)

# ---- group: is building or not
bool_3 = Boolean(and_2)

# ---- group: cell size
num_18 = Number(division_4)

# ----
dispatch_5 = Dispatch(List=pt_17, DispatchPattern=bool_3)  # -> ListA, ListB
dispatch_6 = Dispatch(List=int_43, DispatchPattern=bool_3)  # -> ListA, ListB

# ---- group: color for each type
col_8 = Colour(merge_6)

# ----
division_6 = Division(A=num_18, B=2)

# ---- group: building center
pt_18 = Point(dispatch_5.ListA)

# ---- group: building id
int_44 = Integer(dispatch_6.ListA)

# ----
equals = Equality(FirstNumber=int_44)  # -> Equality, Inequality
multiplication_12 = Multiplication(A=equals.Inequality, B=6)

# ---- group: JSON Text
txt_6 = Text(txt_5)

# ----
move_7 = Move(Geometry=mesh_17, Motion=vec)  # -> Geometry, Transform
move_8 = Move(Geometry=mesh_18, Motion=vec)  # -> Geometry, Transform

# ---- group: base height
panel_30 = Panel("5.0")

# ----
move_9 = Move(Geometry=mesh_16, Motion=vec)  # -> Geometry, Transform
multiplication_13 = Multiplication(A=division_6, B=Slider(0.95, range=0..1))
addition_8 = Addition(A=int_44, B=multiplication_12)
join_2 = TextJoin(Text=["api/table/update/", panel_29])
join_3 = TextJoin(Text=["https://cityio.media.mit.edu/api/table/", panel_29])

# ---- group: url for reading the table json data - copy past to broswer
panel_31 = Panel(join_3)

# ----
neg_5 = Negative(Value=multiplication_13)

# ---- group: delay sending
dam = DataDam(DataA=txt_6, BufferDelay=5000000, BufferMode=2)

# ----
filter_4 = StreamFilter(Gate=0, Stream0=addition_8, Stream1=int_44)
item_13 = ListItem(List=col_8, Index=graft(filter_4), Wrap=False)
pshift_10 = ShiftPaths(Data=item_13, Offset=-1)
dom_2 = ConstructDomain(DomainStart=neg_5, DomainEnd=multiplication_13)
panel_32 = Panel(num_17)
send_table_data = PythonScript(url=panel_28, path=join_2, jsonString=dam)  # -> out
# ---------- send_table_data: Python ----------
import System 
import System.Net 
import System.Uri
import System.IO
import System.Text.Encoding
import json


def postTable(url,stringData,debug=False):
    webclient = System.Net.WebClient()
    webclient.Headers['Content-type'] = 'text/plain'
    
    if debug:
        
        # simple validation before we send
        try:
            json.loads(stringData)
        except:
            print 'invalid string, revise your string data'
            return
        
        # this will block your process
        data = System.Text.Encoding.Default.GetBytes(stringData)
        webclient.UploadData(url,'POST',data)
        
    else:
        data = System.Text.Encoding.Default.GetBytes(stringData)
        webclient.UploadDataAsync(url,'POST',data)

endpoint = System.Uri('{}/{}'.format(url,path))



postTable(endpoint,jsonString)
# rhino crashes using async callbacks,
# so try the following if something is wrong
# postData(endpoint,jsonString,debug=True)
# ---------- end send_table_data ----------

# ---- group: color for each building
col_9 = Colour(pshift_10)

# ----
item_14 = ListItem(List=panel_32, Index=graft(int_44), Wrap=False)
pshift_11 = ShiftPaths(Data=item_14, Offset=-1)

# ---- group: building height factor
number_slider_12 = Slider(3.1, range=0..10)

# ---- group: errors
panel_33 = Panel(send_table_data)

# ----
multiplication_14 = Multiplication(A=pshift_11, B=number_slider_12)

# ---- group: building height of each building
num_19 = Number(multiplication_14)

# ----
addition_9 = Addition(A=num_19, B=panel_30)
dom_3 = ConstructDomain(DomainStart=0, DomainEnd=addition_9)
box_3 = DomainBox(Base=pt_18, X=dom_2, Y=dom_2, Z=dom_3)
move_10 = Move(Geometry=box_3, Motion=vec)  # -> Geometry, Transform

# ---- group: building geo
box_4 = Box(move_10.Geometry)

# ---- group: 3D Buldings
preview_12 = CustomPreview(Geometry=box_4, Shader=col_9)

# ---- group: road
mesh_19 = Mesh(move_7.Geometry)

# ---- group: sidewalk
mesh_20 = Mesh(move_8.Geometry)

# ---- group: blank
mesh_21 = Mesh(move_9.Geometry)

# ==== cluster ModuleCenter
pt = ClusterInput()
int = ClusterInput()
num = ClusterInput()
int_2 = ClusterInput()

# ---- group: y
int_3 = Integer(int)

# ---- group: cell size
num_2 = Number(num)

# ---- group: x
int_4 = Integer(int_2)

# ---- group: center
pt_2 = Point(pt)

# ----
pt_3 = ConstructPoint(XCoordinate=0, YCoordinate=0, ZCoordinate=0)  # disabled
addition = Addition(A=int_4, B=0.5)
vec2pt = Vector2Pt(PointA=pt_3, PointB=pt_2, Unitize=False)  # -> Vector, Length; disabled
addition_2 = Addition(A=int_3, B=0.5)
multiplication = Multiplication(A=addition, B=num_2)
move = Move(Motion=vec2pt.Vector)  # -> Geometry, Transform; disabled
lng = ListLength(List=int_4)  # disabled
multiplication_2 = Multiplication(A=addition_2, B=num_2)
X = UnitX(Factor=multiplication)
repeat = RepeatData(Data=move.Transform, Length=lng)  # disabled
neg = Negative(Value=multiplication_2)
move_2 = Move(Geometry=pt_2, Motion=X)  # -> Geometry, Transform
graft = GraftTree(Tree=move_2.Transform, IncludeEmptyLists=True, IncludeNullItems=True)  # disabled
Y = UnitY(Factor=neg)
pshift = ShiftPaths(Data=repeat, Offset=-1)  # disabled
move_3 = Move(Geometry=move_2.Geometry, Motion=Y)  # -> Geometry, Transform
graft_2 = GraftTree(Tree=move_3.Transform, IncludeEmptyLists=True, IncludeNullItems=True)  # disabled
comp = Compound(Transforms=[graft, graft_2])  # disabled
graft_3 = GraftTree(Tree=pshift, IncludeEmptyLists=True, IncludeNullItems=True)  # disabled
comp_2 = Compound(Transforms=[comp, graft_3])  # disabled

# ---- group: module center
pt_4 = Point(move_3.Geometry)

# ----
pshift_2 = ShiftPaths(Data=comp_2, Offset=-1)  # disabled
transform = Transform(pshift_2)  # disabled
pt_5 = ClusterOutput(pt_4)
transform_2 = ClusterOutput(transform)  # disabled

# ==== cluster MoveToOrgin
num = ClusterInput()
G = ClusterInput()
num_2 = Number(num)
geobottomcenter = GeoBottomCenter(geo=G)
vec2pt = Vector2Pt(PointA=geobottomcenter, PointB=Point(0, 0, 0), Unitize=False)  # -> Vector, Length
move = Move(Geometry=G, Motion=vec2pt.Vector)  # -> Geometry, Transform
scale_nu = ScaleNU(Geometry=move.Geometry, Plane=PlaneXY(0, 0, 0), ScaleX=num_2, ScaleY=num_2, ScaleZ=1)  # -> Geometry, Transform
G_2 = ClusterOutput(scale_nu.Geometry)

# ==== cluster Perspective
int = ClusterInput()
int_2 = ClusterInput()
pt = ClusterInput()

# ---- group: grid extent y
int_3 = Integer(int)

# ---- group: grid extent x
int_4 = Integer(int_2)

# ---- group: Pts Sample Grid Corner
pt_2 = Point(pt)

# ----
subtraction = Subtraction(A=int_4, B=1)
subtraction_2 = Subtraction(A=int_3, B=1)
item = ListItem(List=pt_2, Index=0, Wrap=False)
item_2 = ListItem(List=pt_2, Index=1, Wrap=False)
item_3 = ListItem(List=pt_2, Index=2, Wrap=False)
item_4 = ListItem(List=pt_2, Index=3, Wrap=False)
pt_3 = Point(item_4)
pt_4 = Point(item)
ln = Line(StartPoint=pt_3, EndPoint=pt_4)
pt_5 = Point(item_2)
ln_2 = Line(StartPoint=pt_4, EndPoint=pt_5)
pt_6 = Point(item_3)
ln_3 = Line(StartPoint=pt_6, EndPoint=pt_3)
ln_4 = Line(StartPoint=pt_5, EndPoint=pt_6)
llx = LineLine(Line1=ln, Line2=ln_4)  # -> ParamA, ParamB, PointA, PointB
pt_7 = Point(llx.PointA)
llx_2 = LineLine(Line1=ln_2, Line2=ln_3)  # -> ParamA, ParamB, PointA, PointB
pt_8 = Point(llx_2.PointA)
vec2pt = Vector2Pt(PointA=pt_8, PointB=pt_7, Unitize=False)  # -> Vector, Length
line = LineSDL(Start=pt_3, Direction=vec2pt.Vector, Length=1)
llx_3 = LineLine(Line1=ln_2, Line2=line)  # -> ParamA, ParamB, PointA, PointB
pt_9 = Point(llx_3.PointA)
ln_5 = Line(StartPoint=pt_3, EndPoint=pt_9)
divide = DivideCurve(Curve=ln_5, Count=subtraction_2, Kinks=False)  # -> Points, Tangents, Parameters
ln_6 = Line(StartPoint=pt_8, EndPoint=divide.Points)
llx_4 = LineLine(Line1=ln_4, Line2=line)  # -> ParamA, ParamB, PointA, PointB
pt_10 = Point(llx_4.PointA)
ln_7 = Line(StartPoint=pt_3, EndPoint=pt_10)
divide_2 = DivideCurve(Curve=ln_7, Count=subtraction, Kinks=False)  # -> Points, Tangents, Parameters
ln_8 = Line(StartPoint=pt_7, EndPoint=divide_2.Points)
ln_9 = Line(StartPoint=pt_8, EndPoint=pt_7)

# ---- group: x
line_2 = Line(ln_8)

# ---- group: y
line_3 = Line(ln_6)

# ----
graft = GraftTree(Tree=ln_6, IncludeEmptyLists=True, IncludeNullItems=True)
llx_5 = LineLine(Line1=line_2, Line2=graft)  # -> ParamA, ParamB, PointA, PointB

# ---- group: keystoned grid pts
pt_11 = Point(llx_5.PointA)

# ----
pt_12 = ClusterOutput(pt_11)

# ==== cluster TextFormating
txt = ClusterInput()
txt_2 = Text(txt)

# ---- group: 'Enter'
panel = Panel("")

# ----
split = TextSplit(Text=txt_2, Separators=panel)
lng = ListLength(List=split)
addition = Addition(A=lng, B=1)
division = Division(A=addition, B=2)
series = Series(Start=0, Step=2, Count=division)
item = ListItem(List=split, Index=series, Wrap=False)
pshift = ShiftPaths(Data=item, Offset=1)
graft = GraftTree(Tree=pshift, IncludeEmptyLists=True, IncludeNullItems=True)
split_2 = TextSplit(Text=graft, Separators=",")
pshift_2 = ShiftPaths(Data=split_2, Offset=-2)
txt_3 = Text(pshift_2)
txt_4 = ClusterOutput(txt_3)

# ==== cluster GeoBottomCenter
geo = ClusterInput()
geo_2 = Geometry(geo)
bbox = BoundingBox(Content=geo_2, Plane=PlaneXY(0, 0, 0))  # -> Box, Box_2
box_corners = BoxCorners(Box=bbox.Box)  # -> CornerA, CornerB, CornerC, CornerD, CornerE, CornerF, CornerG, CornerH
pdecon = Deconstruct(Point=box_corners.CornerA)  # -> XComponent, YComponent, ZComponent
pdecon_2 = Deconstruct(Point=box_corners.CornerC)  # -> XComponent, YComponent, ZComponent
addition = Addition(A=pdecon.XComponent, B=pdecon_2.XComponent)
addition_2 = Addition(A=pdecon.YComponent, B=pdecon_2.YComponent)
division = Division(A=addition, B=2)
division_2 = Division(A=addition_2, B=2)
pt = ConstructPoint(XCoordinate=division, YCoordinate=division_2, ZCoordinate=pdecon.ZComponent)
pt_2 = Point(pt)
pt_3 = ClusterOutput(pt_2)
